# Grasshopper definition Amsterdam.gh (Grasshopper 1.0.7)
# plug-ins: Urbano, treesloth01, MinimumBoundingBox, Bifocals, Heteroptera, Pufferfish, LunchBox, Human, NGon, Hops

panel = Panel("""POINT_X
POINT_Y
AGE
OSM_ID
HEIGHT
ENVELOPE_AREA
WALL_AREA
PERIMETER
AREA
HEIGHT/AREA_RATIO
AV_NO_FLOORS
VOLUME
VERTEX_NUMBER
VERTEX_COMPLEXITY
PER(A)/AREA
MBR_LENGTH
MBR_WIDTH
MBR_L/W
ERI
CONVEX_RATIO
RI
DENSITY
VOIDAREA_STD
NO_OF_VOIDS
AV_VERT_ON_BBOX""")

# ---- group: MERT
path = FilePath("C:\Users\james\OneDrive\Desktop\Thesis\Term 2\GIS\ArcGIS\shp exports\GH01\MERT.shp")  # disabled
importshp = ImportShapefileFeatures(ShapefilePath=path, Reproject=True)  # -> Points, Metadata, UTMZone, TranslationVector; disabled

# ----
crv = Curve(<curve referenced from the Rhino model>)  # disabled
crv_2 = Curve(<curve referenced from the Rhino model>)  # disabled
path_2 = FilePath("C:\Users\james\OneDrive\Desktop\Thesis\Term 2\GIS\ArcGIS\Wandsworth Typologies\w_overlappingheights_test1.shp")  # disabled
crv_3 = Curve(<curve referenced from the Rhino model>)  # disabled
path_3 = FilePath("C:\Users\james\OneDrive\Desktop\Thesis\Term 3\ArcGIS\shpfilesdownload\GHBuildings\GH_Main_03\GH_MAIN_02.shp")  # disabled
panel_2 = Panel(path_3)  # disabled
crv_4 = Curve(<curve referenced from the Rhino model>)  # disabled
boundary = BoundarySurfaces(Edges=[crv_2, crv])  # disabled
merge = Merge(Data1=crv, Data2=crv_3, Data3=crv_2)  # disabled
importshp_2 = ImportShapefileFeatures(ShapefilePath=path_2, Reproject=True)  # -> Points, Metadata, UTMZone, TranslationVector; disabled

# ---- group: WAND
importshp_3 = ImportShapefileFeatures(ShapefilePath=path_3, Reproject=True)  # -> Points, Metadata, UTMZone, TranslationVector

# ---- group: MERT_FP
path_4 = FilePath("C:\Users\james\OneDrive\Desktop\Thesis\Term 2\GIS\ArcGIS\shp exports\GH01\MERT_FP.shp")  # disabled
importshp_4 = ImportShapefileFeatures(ShapefilePath=path_4, Reproject=True)  # -> Points, Metadata, UTMZone, TranslationVector; disabled

# ----
crv_5 = Curve(<curve referenced from the Rhino model>)  # disabled
crv_6 = Curve(<curve referenced from the Rhino model>)  # disabled
crv_7 = Curve(<curve referenced from the Rhino model>)  # disabled
panel_3 = Panel(importshp_2.Points)  # disabled
entwine = Entwine(Branch00=crv_6, Branch01=crv_5, Branch02=crv_7, Branch03=merge, Branch04=crv_4, FlattenInputs=True)  # disabled

panel_4 = Panel("""12
15
11
9
10""")  # disabled
boundary_2 = BoundarySurfaces(Edges=entwine)  # disabled
Z = UnitZ(Factor=panel_4)  # disabled
extr = Extrude(Base=boundary_2, Direction=graft(Z))  # disabled
height = Data(extr)  # disabled

swatch = ColourSwatch(SwatchColor=RGBA(255, 0, 0, 80))  # disabled
number_slider = Slider(1.5, range=0..10)  # disabled
swatch_2 = ColourSwatch(SwatchColor=RGBA(0, 0, 255, 80))  # disabled
debrep = DeconstructBrep(Brep=height)  # -> Faces, Edges, Vertices; disabled
meta = Metadata(importshp_2.Metadata)  # disabled
preview = CustomPreview(Geometry=boundary, Material=swatch)  # disabled

tstat = TreeStatistics(Tree=entwine)  # -> Paths, Length, Count; disabled
panel_5 = Panel("1")  # disabled
larger = LargerThan(FirstNumber=tstat.Length, SecondNumber=panel_5)  # -> LargerThan, OrEqualTo; disabled
dispatch = Dispatch(List=tstat.Paths, DispatchPattern=larger.LargerThan)  # -> ListA, ListB; disabled
split = SplitTree(Data=entwine, Masks=flatten(dispatch.ListA))  # -> Positive, Negative; disabled
area = Area(Geometry=split.Positive)  # -> Area, Centroid; disabled
sort = SortList(Keys=area.Area, ValuesA=split.Positive)  # -> Keys, reverse(ValuesA); disabled
merge_2 = Merge(Data1=split.Negative, Data2=sort.ValuesA)  # disabled

# ---- group: LAM_FP
path_5 = FilePath("C:\Users\james\OneDrive\Desktop\Thesis\Term 2\GIS\ArcGIS\shp exports\GH01\LAM_FP.shp")  # disabled
importshp_5 = ImportShapefileFeatures(ShapefilePath=path_5, Reproject=True)  # -> Points, Metadata, UTMZone, TranslationVector; disabled

# ----
previewlw = CustomPreviewLineweights(Geometry=debrep.Edges, Shader=swatch_2, Thickness=number_slider, Absolute=False)  # disabled

prune = PruneTree(Minimum=0, Maximum=0)  # disabled

panel_6 = Panel("MEAN_mean")  # disabled

# ---- group: LAM
path_6 = FilePath("C:\Users\james\OneDrive\Desktop\Thesis\Term 2\GIS\ArcGIS\shp exports\ForGH\LAM.shp")  # disabled
importshp_6 = ImportShapefileFeatures(ShapefilePath=path_6, Reproject=True)  # -> Points, Metadata, UTMZone, TranslationVector; disabled

# ----
crv_8 = Curve(<curve referenced from the Rhino model>)  # disabled

diagram_polylines = Data(simplify(merge_2))  # disabled

# ---- group: SOUT_FP
path_7 = FilePath("C:\Users\james\OneDrive\Desktop\Thesis\Term 2\GIS\ArcGIS\shp exports\GH01\SOUT_FP.shp")  # disabled
importshp_7 = ImportShapefileFeatures(ShapefilePath=path_7, Reproject=True)  # -> Points, Metadata, UTMZone, TranslationVector; disabled

# ----
panel_7 = Panel("0")  # disabled
boundary_3 = BoundarySurfaces(Edges=diagram_polylines)  # disabled
area_2 = Area(Geometry=boundary_3)  # -> Area, Centroid; disabled
item = ListItem(List=diagram_polylines, Index=panel_7, Wrap=True)  # disabled

area_3 = Area(Geometry=item)  # -> Area, Centroid; disabled
division = Division(A=area_2.Area, B=area_3.Area)  # disabled
ma = MassAddition(Input=division)  # -> Result, PartialResults; disabled
void_area = Data(ma.Result)  # disabled
panel_8 = Panel(void_area)  # disabled

lng = ListLength(List=diagram_polylines)  # disabled
panel_9 = Panel("1")  # disabled
larger_2 = LargerThan(FirstNumber=lng, SecondNumber=panel_9)  # -> LargerThan, OrEqualTo; disabled
void = Data(simplify(larger_2.LargerThan))  # disabled
panel_10 = Panel(void)  # disabled

swatch_3 = ColourSwatch(SwatchColor=RGBA(0, 0, 255, 80))  # disabled

# ---- group: SOUT
path_8 = FilePath("C:\Users\james\OneDrive\Desktop\Thesis\Term 2\GIS\ArcGIS\shp exports\ForGH\SOUT.shp")  # disabled
importshp_8 = ImportShapefileFeatures(ShapefilePath=path_8, Reproject=True)  # -> Points, Metadata, UTMZone, TranslationVector; disabled

# ----
debrep_2 = DeconstructBrep(Brep=boundary_3)  # -> Faces, Edges, Vertices; disabled
lng_2 = ListLength(List=debrep_2.Vertices)  # disabled
vertex_number = Data(lng_2)  # disabled
panel_11 = Panel(vertex_number)  # disabled

preview_2 = CustomPreview(Geometry=boundary_3, Material=swatch_3)  # disabled
swatch_4 = ColourSwatch(SwatchColor=RGBA(0, 0, 255, 80))  # disabled

boundary_4 = BoundarySurfaces(Edges=item)  # disabled
debrep_3 = DeconstructBrep(Brep=boundary_4)  # -> Faces, Edges, Vertices; disabled
cir = Circle(Plane=debrep_3.Vertices, Radius=2)  # disabled
trim = TrimWithRegion(Curve=cir, Region=debrep_3.Faces)  # -> Inside, Outside; disabled
crv_9 = Curve(trim.Inside)  # disabled
path_mapper = PathMapper(crv_9, source="{A;B;C}", target="{A}")  # disabled
darc = DeconstructArc(Arc=path_mapper)  # -> BasePlane, Radius, Angle; disabled
deg = Degrees(Radians=darc.Angle)  # disabled

pt = Point(debrep_2.Vertices)  # disabled
preview_3 = CustomPreview(Geometry=pt, Material=swatch_4)  # disabled

tstat_2 = TreeStatistics(Tree=diagram_polylines)  # -> Paths, Length, Count; disabled
panel_12 = Panel("1")  # disabled
larger_3 = LargerThan(FirstNumber=tstat_2.Length, SecondNumber=panel_12)  # -> LargerThan, OrEqualTo; disabled
dispatch_2 = Dispatch(List=tstat_2.Paths, DispatchPattern=larger_3.LargerThan)  # -> ListA, ListB; disabled
split_2 = SplitTree(Data=diagram_polylines, Masks=flatten(dispatch_2.ListA))  # -> Positive, Negative; disabled

panel_13 = Panel("0")  # disabled
item_2 = ListItem(List=split_2.Positive, Index=panel_13, Wrap=True)  # disabled

shp_curves = Data(Tree({0}: [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], {1}: [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], {2}: [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], {3}: [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], {4}: [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], {5}: [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]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))  # disabled
data = Data()

panel_14 = Panel("0")  # disabled
item_3 = ListItem(List=split_2.Negative, Index=panel_14, Wrap=True)  # disabled

merge_3 = Merge()  # disabled
match = MatchTree()  # disabled
swatch_5 = ColourSwatch(SwatchColor=RGBA(0, 0, 255, 80))  # disabled
crv_10 = Curve(Tree({0}: [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], {1}: [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], {2}: [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], {3}: [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], {4}: [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], {5}: [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]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))  # disabled
swatch_6 = ColourSwatch(SwatchColor=RGBA(0, 0, 255, 80))  # disabled
crv_11 = Curve(Tree({0}: [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], {1}: [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], {2}: [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], {3}: [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], {4}: [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], {5}: [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]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))  # disabled

panel_15 = Panel("0")  # disabled
cull_i = CullIndex(List=split_2.Positive, Indices=panel_15, Wrap=True)  # disabled

panel_16 = Panel("0.99999")  # disabled
panel_17 = Panel("0")  # disabled
panel_18 = Panel("0")  # disabled
panel_19 = Panel("0")  # disabled
data_2 = Data(Tree({0}: [5.147323132], {1}: [6.904306889], {2}: [5.870810986], {3}: [6.499577999], {4}: [8.857197762], {5}: [5.511067867]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))  # disabled
heights = Data(Tree({0;0}: [5.147323132], {1;0}: [6.904306889], {2;0}: [5.870810986], {3;0}: [6.499577999], {4;0}: [8.857197762], {5;0}: [5.511067867]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))  # disabled
panel_20 = Panel("4")  # disabled
panel_21 = Panel("4")  # disabled
panel_22 = Panel("0")  # disabled
panel_23 = Panel("0")  # disabled
panel_24 = Panel("""OSM_ID
POINT_X
POINT_Y
AGE
HEIGHT
AREA
VOLUME
MBR_LENGTH
MBR_WIDTH
MBR_L/W
PERIMETER
WALL_AREA
VERTEX_COUNT
VERTEX_COMPLEXITY
ERI
CONVEX_RATIO
RI
DENSITY
NO_VOIDS(+1)
VOID(AREA-VOIDAREA)
BBOX/AREA
PER/AREA
VOID_AREA_STD
POINT_BBOX
NO_INTRUSIONS
SEGMENTS_STD
SEGMENTS_AV""")  # disabled
panel_25 = Panel("""POINT_X
POINT_Y
AGE
OSM_ID
HEIGHT
ENVELOPE_AREA
WALL_AREA
PERIMETER
AREA
HEIGHT/AREA_RATIO
AV_NO_FLOORS
VOLUME
VERTEX_NUMBER
VERTEX_COMPLEXITY
PER(A)/AREA
MBR_LENGTH
MBR_WIDTH
MBR_L/W
ERI
CONVEX_RATIO
RI
DENSITY
VOIDAREA_STD
NO_OF_VOIDS
AV_VERT_ON_BBOX
NO_OF_INTRUSIONS(+1)
BBOXAREA/AREA""")  # disabled
hops = Hops(
    CacheResultsInMemory=True,
    CacheSolveResults=True,
    RemoteSolveVersion=(0, 1, 0),
    ShowInput_Enabled=False,
    ShowInput_Path=False,
    SynchronousSolve=True)  # disabled

toggle = BooleanToggle(True)  # disabled
meta_2 = Metadata(importshp_2.Metadata)  # disabled
pline = PolyLine(Vertices=importshp_2.Points, Closed=toggle)  # disabled
panel_26 = Panel("MEAN_mean")  # disabled
panel_27 = Panel("OBJECTID")  # disabled
crv_12 = Curve(simplify(pline))  # disabled

unflatten = UnflattenTree(Tree=meta_2, Guide=pline)  # disabled
unflatten_2 = UnflattenTree(Tree=meta, Guide=pline)  # disabled

demeta = DeconstructMetadata(Metadata=unflatten)  # -> Keys, Values; disabled
demeta_2 = DeconstructMetadata(Metadata=unflatten)  # -> Keys, Values; disabled
keysearch = KeyValueSearch(Keys=demeta.Keys, Values=demeta.Values, Search=panel_26)  # -> simplify(Result); disabled
keysearch_2 = KeyValueSearch(Keys=demeta_2.Keys, Values=demeta_2.Values, Search=panel_27)  # -> simplify(Result); disabled
data_3 = Data(simplify(keysearch))  # disabled

demeta_3 = DeconstructMetadata(Metadata=unflatten_2)  # -> Keys, Values; disabled
viewer = ParamViewer(crv_12)  # disabled
keysearch_3 = KeyValueSearch(Keys=demeta_3.Keys, Values=demeta_3.Values, Search=panel_6)  # -> simplify(Result); disabled
data_4 = Data(simplify(keysearch_2))  # disabled
shift = ShiftPaths(Data=crv_12, Offset=-1)  # disabled
data_5 = Data(simplify(keysearch_3))  # disabled

area_4 = Area(Geometry=crv_12)  # -> Area, Centroid; disabled
panel_28 = Panel("10")  # disabled
smaller = SmallerThan(FirstNumber=area_4.Area, SecondNumber=panel_28)  # -> SmallerThan, OrEqualTo; disabled
dispatch_3 = Dispatch(List=crv_12, DispatchPattern=smaller.SmallerThan)  # -> ListA, ListB; disabled
dispatch_4 = Dispatch(List=data_3, DispatchPattern=smaller.SmallerThan)  # -> ListA, ListB; disabled
dispatch_5 = Dispatch(List=data_4, DispatchPattern=smaller.SmallerThan)  # -> ListA, ListB; disabled
data_6 = Data(dispatch_4.ListB)  # disabled
crv_13 = Curve(dispatch_3.ListB)  # disabled

boundary_5 = BoundarySurfaces(Edges=shift)  # disabled
panel_29 = Panel(shift)  # disabled

panel_30 = Panel("2.1")  # disabled
smaller_2 = SmallerThan(FirstNumber=data_6, SecondNumber=panel_30)  # -> SmallerThan, OrEqualTo; disabled
dispatch_6 = Dispatch(List=crv_13, DispatchPattern=smaller_2.SmallerThan)  # -> ListA, ListB; disabled
dispatch_7 = Dispatch(List=dispatch_5.ListB, DispatchPattern=smaller_2.SmallerThan)  # -> ListA, ListB; disabled
dispatch_8 = Dispatch(List=data_6, DispatchPattern=smaller_2.SmallerThan)  # -> ListA, ListB; disabled
data_7 = Data(dispatch_8.ListB)  # disabled
Z_2 = UnitZ(Factor=data_7)  # disabled
crv_14 = Curve(dispatch_6.ListB)  # disabled

mean_height = Data(data_7)  # disabled

meta_3 = Metadata(importshp_3.Metadata)
meta_4 = Metadata(importshp_3.Metadata)
pline_2 = PolyLine(Vertices=importshp_3.Points, Closed=Toggle(False))  # -> simplify(Polyline)
unflatten_3 = UnflattenTree(Tree=meta_4, Guide=pline_2)
demeta_4 = DeconstructMetadata(Metadata=unflatten_3)  # -> Keys, Values
keysearch_4 = KeyValueSearch(Keys=demeta_4.Keys, Values=demeta_4.Values, Search="osm_id")  # -> simplify(Result)
shift_2 = ShiftPaths(Data=keysearch_4, Offset=-1)
data_8 = Data(simplify(shift_2))

unflatten_4 = UnflattenTree(Tree=meta_3, Guide=pline_2)
polylines = Data(pline_2)
join = JoinCurves(Curves=polylines, Preserve=False)  # -> simplify(Curves)

demeta_5 = DeconstructMetadata(Metadata=unflatten_4)  # -> Keys, Values
keysearch_5 = KeyValueSearch(Keys=demeta_5.Keys, Values=demeta_5.Values, Search="height")  # -> simplify(Result)
shift_3 = ShiftPaths(Data=keysearch_5, Offset=-1)
data_9 = Data(simplify(shift_3))
shift_4 = ShiftPaths(Data=join, Offset=-1)

tstat_3 = TreeStatistics(Tree=shift_4)  # -> Paths, Length, Count
larger_4 = LargerThan(FirstNumber=tstat_3.Length, SecondNumber="1")  # -> LargerThan, OrEqualTo
dispatch_9 = Dispatch(List=tstat_3.Paths, DispatchPattern=larger_4.LargerThan)  # -> ListA, ListB
split_3 = SplitTree(Data=shift_4, Masks=flatten(dispatch_9.ListA))  # -> Positive, Negative
area_5 = Area(Geometry=split_3.Positive)  # -> Area, Centroid
sort_2 = SortList(Keys=area_5.Area, ValuesA=split_3.Positive)  # -> reverse(Keys), reverse(ValuesA)
merge_4 = Merge(Data1=split_3.Negative, Data2=sort_2.ValuesA)

item_4 = ListItem(List=data_8, Index="0", Wrap=True)
item_5 = ListItem(List=data_9, Index="0", Wrap=True)

osm_id = Data(data_8)
height_2 = Data(simplify(data_9))

polylines_2 = Data(simplify(merge_4))
join_2 = TextJoin(Text=polylines_2, Join=",")

join_3 = TextJoin(Text=height_2, Join=",")
join_4 = TextJoin(Text=osm_id, Join=",")
panel_31 = Panel(join_2)

item_6 = ListItem(List=polylines_2, Index="0", Wrap=True)

item_7 = ListItem(List=osm_id, Index="0", Wrap=True)
item_8 = ListItem(List=height_2, Index="0", Wrap=True)
height_3 = Data(simplify(item_8))
osm_id_2 = Data(simplify(item_7))
panel_32 = Panel(osm_id_2)
panel_33 = Panel(height_3)
diagram_polylines_2 = Data(simplify(polylines_2))

# ---- group: Area
boundary_6 = BoundarySurfaces(Edges=polylines_2)  # disabled
area_6 = Area(Geometry=boundary_6)  # -> Area, Centroid; disabled

# ----
tstat_4 = TreeStatistics(Tree=diagram_polylines_2)  # -> Paths, Length, Count; disabled
panel_34 = Panel("1")  # disabled
larger_5 = LargerThan(FirstNumber=tstat_4.Length, SecondNumber=panel_34)  # -> LargerThan, OrEqualTo; disabled
dispatch_10 = Dispatch(List=tstat_4.Paths, DispatchPattern=larger_5.LargerThan)  # -> ListA, ListB; disabled
split_4 = SplitTree(Data=diagram_polylines_2, Masks=flatten(dispatch_10.ListA))  # -> Positive, Negative; disabled

cull_i_2 = CullIndex(List=polylines_2, Indices="0", Wrap=True)  # -> simplify(List)
lng_3 = ListLength(List=cull_i_2)
area_7 = Area(Geometry=cull_i_2)  # -> Area, Centroid
ma_2 = MassAddition(Input=area_7.Area)  # -> Result, PartialResults
nullrep = ReplaceNulls(Items=ma_2.Result, Replacements="0")  # -> Items, Count
division_2 = Division(A=nullrep.Items, B=lng_3)
nullrep_2 = ReplaceNulls(Items=division_2, Replacements="0")  # -> Items, Count
subtraction = Subtraction(A=area_7.Area, B=nullrep_2.Items)
sqr = Square(Value=subtraction)
ma_3 = MassAddition(Input=sqr)  # -> Result, PartialResults
division_3 = Division(A=ma_3.Result, B=lng_3)
nullrep_3 = ReplaceNulls(Items=division_3, Replacements="0")  # -> Items, Count
sqrt = SquareRoot(Value=nullrep_3.Items)
void_area_standard_deviation = Data(sqrt)
panel_35 = Panel(void_area_standard_deviation)

lng_4 = ListLength(List=polylines_2)
no_of_voids_1 = Data(lng_4)
panel_36 = Panel(no_of_voids_1)

item_9 = ListItem(List=flatten(boundary_6), Index=panel_20, Wrap=True)  # disabled

disc = Discontinuity(Curve=item_6, Level=1)  # -> simplify(Points), Parameters; disabled
area_8 = Area(Geometry=boundary_6)  # -> Area, Centroid; disabled
convexhull = ConvexHull(Points=disc.Points)  # -> Mesh, Polyline, Points, Index; disabled
boundary_7 = BoundarySurfaces(Edges=convexhull.Polyline)  # -> graft(Surfaces); disabled
area_9 = Area(Geometry=boundary_7)  # -> Area, Centroid; disabled
division_4 = Division(A=area_9.Area, B=area_8.Area)  # disabled
convex_ratio = Data(simplify(division_4))  # disabled
panel_37 = Panel(convex_ratio)  # disabled

disc_2 = Discontinuity(Curve=item_6, Level=1)  # -> Points, Parameters; disabled
center = Center(Geometric=boundary_6)  # -> Center, Dimension; disabled
len = Length(Curve=item_6)  # disabled
dist = Distance(PointA=center.Center, PointB=disc_2.Points)  # -> simplify(Distance); disabled
area_10 = Area(Geometry=boundary_6)  # -> Area, Centroid; disabled
sqr_2 = Square(Value=len)  # disabled
lng_5 = ListLength(List=dist)  # disabled
ma_4 = MassAddition(Input=dist)  # -> Result, PartialResults; disabled
addition = Addition(A=sqr_2, B=area_10.Area)  # disabled
division_5 = Division(A=ma_4.Result, B=lng_5)  # disabled
division_6 = Division(A=ma_4.Result, B=lng_5)  # disabled
sqr_3 = Square(Value=division_5)  # disabled
panel_38 = Panel("42.62")  # disabled
division_7 = Division(A=sqr_3, B=addition)  # disabled
multiplication = Multiplication(A=division_7, B=panel_38)  # disabled
ri = Data(multiplication)  # disabled
panel_39 = Panel(ri)  # disabled

cull_i_3 = CullIndex(List=polylines_2, Indices=panel_22, Wrap=True)  # disabled
area_11 = Area(Geometry=cull_i_3)  # -> Area, Centroid; disabled
nullrep_4 = ReplaceNulls(Items=area_11.Area, Replacements=panel_23)  # -> Items, Count; disabled
ma_5 = MassAddition(Input=nullrep_4.Items)  # -> Result, PartialResults; disabled
panel_40 = Panel(nullrep_4.Items)  # disabled

pt_2 = Point(importshp_3.Points)
meta_5 = Metadata(importshp_3.Metadata)
meta_6 = Metadata(importshp_3.Metadata)
meta_7 = Metadata(importshp_3.Metadata)
shift_5 = ShiftPaths(Data=pt_2, Offset=-1)
unflatten_5 = UnflattenTree(Tree=meta_5, Guide=pline_2)
unflatten_6 = UnflattenTree(Tree=meta_6, Guide=pline_2)
unflatten_7 = UnflattenTree(Tree=meta_7, Guide=pline_2)
demeta_6 = DeconstructMetadata(Metadata=unflatten_7)  # -> Keys, Values
demeta_7 = DeconstructMetadata(Metadata=unflatten_5)  # -> Keys, Values
demeta_8 = DeconstructMetadata(Metadata=unflatten_6)  # -> Keys, Values
keysearch_6 = KeyValueSearch(Keys=demeta_7.Keys, Values=demeta_7.Values, Search="age")  # -> simplify(Result)
keysearch_7 = KeyValueSearch(Keys=demeta_8.Keys, Values=demeta_8.Values, Search="POINT_Y")  # -> simplify(Result)
keysearch_8 = KeyValueSearch(Keys=demeta_6.Keys, Values=demeta_6.Values, Search="POINT_X")  # -> simplify(Result)

shift_6 = ShiftPaths(Data=keysearch_8, Offset=-1)
shift_7 = ShiftPaths(Data=keysearch_6, Offset=-1)
shift_8 = ShiftPaths(Data=keysearch_7, Offset=-1)
item_10 = ListItem(List=shift_6, Index=0, Wrap=True)
item_11 = ListItem(List=shift_7, Index=0, Wrap=True)
item_12 = ListItem(List=shift_8, Index=0, Wrap=True)
panel_41 = Panel(item_10)

point_x = Data(item_10)
point_y = Data(item_12)
age = Data(item_11)
panel_42 = Panel(item_12)
panel_43 = Panel(item_11)

number_slider_2 = Slider(0.25, range=0..1)  # disabled
number_slider_3 = Slider(0.659, range=0..1)  # disabled
arcdim = ArcDimension(Arc=crv_9, Offset=number_slider_2, Text="{0:0.0}°", Size=number_slider_3)  # disabled
vertex_angles = Data(simplify(deg))  # disabled
number_slider_4 = Slider(2, range=0..6)  # disabled
panel_44 = Panel("2")  # disabled

panel_45 = Panel("90")  # disabled
larger_6 = LargerThan(FirstNumber=vertex_angles, SecondNumber=panel_45)  # -> LargerThan, OrEqualTo; disabled
dispatch_11 = Dispatch(List=vertex_angles, DispatchPattern=larger_6.OrEqualTo)  # -> ListA, ListB; disabled
panel_46 = Panel("135")  # disabled
smaller_3 = SmallerThan(FirstNumber=dispatch_11.ListA, SecondNumber=panel_46)  # -> SmallerThan, OrEqualTo; disabled
dispatch_12 = Dispatch(List=dispatch_11.ListA, DispatchPattern=smaller_3.OrEqualTo)  # -> ListA, ListB; disabled
panel_47 = Panel("180")  # disabled
_90_to_135 = Data(dispatch_12.ListA)  # disabled
smaller_4 = SmallerThan(FirstNumber=dispatch_12.ListB, SecondNumber=panel_47)  # -> SmallerThan, OrEqualTo; disabled

panel_48 = Panel("270")  # disabled
larger_7 = LargerThan(FirstNumber=vertex_angles, SecondNumber=panel_48)  # -> LargerThan, OrEqualTo; disabled
dispatch_13 = Dispatch(List=vertex_angles, DispatchPattern=larger_7.OrEqualTo)  # -> ListA, ListB; disabled
panel_49 = Panel("315")  # disabled
smaller_5 = SmallerThan(FirstNumber=dispatch_13.ListA, SecondNumber=panel_49)  # -> SmallerThan, OrEqualTo; disabled
dispatch_14 = Dispatch(List=dispatch_13.ListA, DispatchPattern=smaller_5.OrEqualTo)  # -> ListA, ListB; disabled
panel_50 = Panel("180")  # disabled
_270_to_315 = Data(dispatch_14.ListA)  # disabled

panel_51 = Panel("89.999999")  # disabled
smaller_6 = SmallerThan(FirstNumber=vertex_angles, SecondNumber=panel_51)  # -> SmallerThan, OrEqualTo; disabled
dispatch_15 = Dispatch(List=vertex_angles, DispatchPattern=smaller_6.SmallerThan)  # -> ListA, ListB; disabled
panel_52 = Panel("45")  # disabled
larger_8 = LargerThan(FirstNumber=dispatch_15.ListA, SecondNumber=panel_52)  # -> LargerThan, OrEqualTo; disabled
dispatch_16 = Dispatch(List=dispatch_15.ListA, DispatchPattern=larger_8.OrEqualTo)  # -> ListA, ListB; disabled
_90_to_45 = Data(dispatch_16.ListA)  # disabled
_0_to_45 = Data(dispatch_16.ListB)  # disabled

panel_53 = Panel("10")  # disabled
panel_54 = Panel("0.1")  # disabled
panel_55 = Panel("89.999999")  # disabled
panel_56 = Panel("45")  # disabled
dom = ConstructDomain(DomainStart=panel_55, DomainEnd=panel_56)  # disabled
dom_2 = ConstructDomain(DomainStart=panel_54, DomainEnd=panel_53)  # disabled
remap = RemapNumbers(Value=_90_to_45, Source=dom, Target=dom_2)  # -> Mapped, Clipped; disabled

panel_57 = Panel("0.1")  # disabled
panel_58 = Panel("10")  # disabled
panel_59 = Panel("0")  # disabled
panel_60 = Panel("44.999999")  # disabled
dom_3 = ConstructDomain(DomainStart=panel_59, DomainEnd=panel_60)  # disabled
dom_4 = ConstructDomain(DomainStart=panel_57, DomainEnd=panel_58)  # disabled
remap_2 = RemapNumbers(Value=_0_to_45, Source=dom_3, Target=dom_4)  # -> Mapped, Clipped; disabled

panel_61 = Panel("10")  # disabled
panel_62 = Panel("0.1")  # disabled
panel_63 = Panel("90")  # disabled
panel_64 = Panel("135")  # disabled
dom_5 = ConstructDomain(DomainStart=panel_63, DomainEnd=panel_64)  # disabled
dom_6 = ConstructDomain(DomainStart=panel_62, DomainEnd=panel_61)  # disabled
remap_3 = RemapNumbers(Value=_90_to_135, Source=dom_5, Target=dom_6)  # -> Mapped, Clipped; disabled

panel_65 = Panel("10")  # disabled
panel_66 = Panel("0.1")  # disabled
panel_67 = Panel("270.111111")  # disabled
panel_68 = Panel("315")  # disabled
dom_7 = ConstructDomain(DomainStart=panel_67, DomainEnd=panel_68)  # disabled
dom_8 = ConstructDomain(DomainStart=panel_66, DomainEnd=panel_65)  # disabled
remap_4 = RemapNumbers(Value=_270_to_315, Source=dom_7, Target=dom_8)  # -> Mapped, Clipped; disabled

extr_2 = Extrude(Base=crv_14, Direction=Z_2)  # disabled
panel_69 = Panel("1")  # disabled
panel_70 = Panel("1")  # disabled

clean = CleanTree(RemoveNulls=True, RemoveInvalid=True, RemoveEmpty=True, Tree=extr_2)  # disabled

cap = CapHoles(Brep=clean)  # disabled

trim_2 = TrimTree(Tree=cap, Depth=1)  # disabled

tstat_5 = TreeStatistics(Tree=trim_2)  # -> Paths, Length, Count; disabled
larger_9 = LargerThan(FirstNumber=tstat_5.Length, SecondNumber=panel_69)  # -> LargerThan, OrEqualTo; disabled
dispatch_17 = Dispatch(List=tstat_5.Paths, DispatchPattern=larger_9.LargerThan)  # -> ListA, ListB; disabled
split_5 = SplitTree(Data=trim_2, Masks=flatten(dispatch_17.ListA))  # -> Positive, Negative; disabled
split_6 = SplitList(List=split_5.Positive, Index=panel_70)  # -> ListA, ListB; disabled
sdiff = SolidDifference(BrepsA=split_6.ListA, BrepsB=split_6.ListB)  # disabled

shift_9 = ShiftPaths(Data=sdiff, Offset=-1)  # disabled

merge_5 = Merge(Data1=split_5.Negative, Data2=shift_9)  # disabled

panel_71 = Panel(merge_5)  # disabled

brep = Brep(merge_5)  # disabled
debrep_4 = DeconstructBrep(Brep=brep)  # -> Faces, Edges, Vertices; disabled
area_12 = Area(Geometry=debrep_4.Faces)  # -> Area, Centroid; disabled
pdecon = Deconstruct(Point=area_12.Centroid)  # -> XComponent, YComponent, ZComponent; disabled
sort_3 = SortList(Keys=pdecon.ZComponent, ValuesA=debrep_4.Faces)  # -> Keys, ValuesA; disabled
item_13 = ListItem(List=sort_3.ValuesA, Index=0, Wrap=True)  # disabled
shift_10 = ShiftPaths(Data=item_13, Offset=-1)  # disabled

footprint_srf = Data(shift_10)  # disabled
join_5 = BrepJoin(Breps=sort_3.ValuesA)  # -> Breps, Closed; disabled
panel_72 = Panel(join_5.Breps)  # disabled
split_7 = SplitTree(Data=shift_10, Masks=flatten(dispatch_17.ListA))  # -> Positive, Negative; disabled
edges = BrepEdges(Brep=shift_10)  # -> Naked, Interior, NonManifold; disabled
join_6 = JoinCurves(Curves=edges.Naked, Preserve=False)  # -> simplify(Curves); disabled
crv_15 = Curve(join_6)  # disabled

# ---- group: No. Of Voids
lng_6 = ListLength(List=split_7.Positive)  # disabled
no_of_voids = Data(lng_6)  # disabled
bool = Boolean(lng_6)  # disabled
panel_73 = Panel(bool)  # disabled

# ---- group: VOLUME
volume = Volume(Geometry=merge_5)  # -> Volume, Centroid; disabled
panel_74 = Panel(volume.Volume)  # disabled

# ---- group: AREA
area_13 = Area(Geometry=footprint_srf)  # -> Area, Centroid; disabled
footprint_area = Data(simplify(area_13.Area))  # disabled
panel_75 = Panel(footprint_area)  # disabled

# ---- group: Perimeter
panel_76 = Panel("0")  # disabled
item_14 = ListItem(List=crv_15, Index=panel_76, Wrap=True)  # disabled
len_2 = Length(Curve=item_14)  # disabled
panel_77 = Panel(len_2)  # disabled

# ----
boundary_8 = BoundarySurfaces(Edges=item_14)  # disabled
area_14 = Area(Geometry=boundary_8)  # -> Area, Centroid; disabled
dedomain = DeconstructDomain(Domain=footprint_area)  # -> Start, End; disabled
panel_78 = Panel("0.0 to 1.0")  # disabled
remap_5 = RemapNumbers(Value=dedomain.End, Source=area_14.Area, Target=panel_78)  # -> Mapped, Clipped; disabled

# ---- group: No. of VERTICES
debrep_5 = DeconstructBrep(Brep=shift_10)  # -> Faces, Edges, Vertices; disabled
pt_3 = Point(debrep_5.Vertices)  # disabled
lng_7 = ListLength(List=pt_3)  # -> simplify(Length); disabled
panel_79 = Panel(lng_7)  # disabled

# ----
smaller_7 = SmallerThan(FirstNumber=remap_5.Mapped, SecondNumber=panel_16)  # -> SmallerThan, OrEqualTo; disabled
panel_80 = Panel(remap_5.Mapped)  # disabled
data_10 = Data(smaller_7.SmallerThan)  # disabled
panel_81 = Panel(smaller_7.SmallerThan)  # disabled

panel_82 = Panel("269.999999")  # disabled
smaller_8 = SmallerThan(FirstNumber=vertex_angles, SecondNumber=panel_82)  # -> SmallerThan, OrEqualTo; disabled
dispatch_18 = Dispatch(List=vertex_angles, DispatchPattern=smaller_8.SmallerThan)  # -> ListA, ListB; disabled
panel_83 = Panel("225")  # disabled
larger_10 = LargerThan(FirstNumber=dispatch_18.ListA, SecondNumber=panel_83)  # -> LargerThan, OrEqualTo; disabled
dispatch_19 = Dispatch(List=dispatch_18.ListA, DispatchPattern=larger_10.OrEqualTo)  # -> ListA, ListB; disabled
panel_84 = Panel("180")  # disabled
larger_11 = LargerThan(FirstNumber=dispatch_19.ListB, SecondNumber=panel_84)  # -> LargerThan, OrEqualTo; disabled
_225_to_270 = Data(dispatch_19.ListA)  # disabled

panel_85 = Panel("225")  # disabled
panel_86 = Panel("269.999999")  # disabled
panel_87 = Panel("10")  # disabled
panel_88 = Panel("0.1")  # disabled
dom_9 = ConstructDomain(DomainStart=panel_85, DomainEnd=panel_86)  # disabled
dom_10 = ConstructDomain(DomainStart=panel_88, DomainEnd=panel_87)  # disabled
remap_6 = RemapNumbers(Value=_225_to_270, Source=dom_9, Target=dom_10)  # -> Mapped, Clipped; disabled

shp_curves_2 = Data(crv_15)  # disabled
buildings_with_voids = Data(data_10)  # disabled
no_of_vertices = Data(lng_7)  # disabled
perimeter_distance = Data(len_2)  # disabled
volume_2 = Data(volume.Volume)  # disabled
footprint_area_2 = Data(footprint_area)  # disabled
compactness = Data(remap_5.Mapped)  # disabled

panel_89 = Panel(compactness)  # disabled

crv_16 = Curve(item_2)  # disabled
panel_90 = Panel("0")  # disabled

explode = Explode(Curve=crv_16, Recursive=True)  # -> Segments, Vertices; disabled
area_15 = Area(Geometry=crv_16)  # -> Area, Centroid; disabled
minbb2d = MinimumBoundingBox2D(Points=explode.Vertices, Plane=area_15.Centroid)  # disabled
boundary_9 = BoundarySurfaces(Edges=minbb2d)  # -> simplify(Surfaces); disabled
dim = Dimensions(Surface=boundary_9)  # -> UDimension, VDimension; disabled
panel_91 = Panel("3")  # disabled
division_8 = Division(A=dim.UDimension, B=panel_91)  # disabled
division_9 = Division(A=dim.VDimension, B=panel_91)  # disabled
quads = QuadPanels(Surface=boundary_9, UDivisions=division_8, VDivisions=division_9)  # -> simplify(Panels); disabled
data_11 = Data(quads)  # disabled

area_16 = Area(Geometry=data_11)  # -> Area, Centroid; disabled
incurve = PointInCurve(Point=area_16.Centroid, Curve=item_2)  # -> Relationship, Point; disabled
dispatch_20 = Dispatch(List=area_16.Centroid, DispatchPattern=incurve.Relationship)  # -> ListA, ListB; disabled
pt_4 = Point(dispatch_20.ListA)  # disabled

dispatch_21 = Dispatch(List=dispatch_19.ListB, DispatchPattern=larger_11.LargerThan)  # -> ListA, ListB; disabled
_315_to_360 = Data(dispatch_14.ListB)  # disabled
dispatch_22 = Dispatch(List=dispatch_12.ListB, DispatchPattern=smaller_4.SmallerThan)  # -> ListA, ListB; disabled

_180_to_225 = Data(dispatch_21.ListA)  # disabled

panel_92 = Panel("0.1")  # disabled
panel_93 = Panel("10")  # disabled
panel_94 = Panel("180.111111")  # disabled
panel_95 = Panel("224.999999")  # disabled
dom_11 = ConstructDomain(DomainStart=panel_95, DomainEnd=panel_94)  # disabled
dom_12 = ConstructDomain(DomainStart=panel_92, DomainEnd=panel_93)  # disabled
remap_7 = RemapNumbers(Value=_180_to_225, Source=dom_11, Target=dom_12)  # -> Mapped, Clipped; disabled

panel_96 = Panel("360")  # disabled
panel_97 = Panel("315.111111")  # disabled
panel_98 = Panel("10")  # disabled
panel_99 = Panel("0.1")  # disabled
dom_13 = ConstructDomain(DomainStart=panel_97, DomainEnd=panel_96)  # disabled
dom_14 = ConstructDomain(DomainStart=panel_99, DomainEnd=panel_98)  # disabled
remap_8 = RemapNumbers(Value=_315_to_360, Source=dom_13, Target=dom_14)  # -> Mapped, Clipped; disabled

panel_100 = Panel("10")  # disabled
panel_101 = Panel("0.1")  # disabled
panel_102 = Panel("180")  # disabled
panel_103 = Panel("135.111111")  # disabled
dom_15 = ConstructDomain(DomainStart=panel_102, DomainEnd=panel_103)  # disabled
dom_16 = ConstructDomain(DomainStart=panel_101, DomainEnd=panel_100)  # disabled
remap_9 = RemapNumbers(Value=dispatch_22.ListA, Source=dom_15, Target=dom_16)  # -> Mapped, Clipped; disabled

merge_6 = Merge(
    Data1=remap_3.Mapped,
    Data2=remap_9.Mapped,
    Data3=remap.Mapped,
    Data4=remap_2.Mapped,
    Data5=remap_7.Mapped,
    Data6=remap_6.Mapped,
    Data7=remap_8.Mapped,
    Data8=remap_4.Mapped)  # disabled
roundd = RoundToDecimalPlace(NumberX=merge_6, DecimalPlace=number_slider_4, RoundType=panel_44)  # -> Rounded, Difference; disabled
ma_6 = MassAddition(Input=roundd.Rounded)  # -> Result, PartialResults; disabled
vertex_complexity = Data(ma_6.Result)  # disabled
panel_104 = Panel(vertex_complexity)  # disabled

crv_17 = Curve(item_3)  # disabled

explode_2 = Explode(Curve=crv_17, Recursive=True)  # -> Segments, Vertices; disabled
area_17 = Area(Geometry=crv_17)  # -> Area, Centroid; disabled
minbb2d_2 = MinimumBoundingBox2D(Points=explode_2.Vertices, Plane=area_17.Centroid)  # disabled
boundary_10 = BoundarySurfaces(Edges=minbb2d_2)  # -> simplify(Surfaces); disabled
dim_2 = Dimensions(Surface=boundary_10)  # -> UDimension, VDimension; disabled
panel_105 = Panel("3")  # disabled
division_10 = Division(A=dim_2.UDimension, B=panel_105)  # disabled
division_11 = Division(A=dim_2.VDimension, B=panel_105)  # disabled
quads_2 = QuadPanels(Surface=boundary_10, UDivisions=division_10, VDivisions=division_11)  # -> simplify(Panels); disabled
data_12 = Data(quads_2)  # disabled

area_18 = Area(Geometry=data_12)  # -> Area, Centroid; disabled
incurve_2 = PointInCurve(Point=area_18.Centroid, Curve=item_3)  # -> Relationship, Point; disabled
dispatch_23 = Dispatch(List=area_18.Centroid, DispatchPattern=incurve_2.Relationship)  # -> ListA, ListB; disabled
pt_5 = Point(dispatch_23.ListA)  # disabled
crv_cp = CurveClosestPoint(Point=pt_5, Curve=split_2.Negative)  # -> Point, Parameter, Distance; disabled
lng_8 = ListLength(List=pt_5)  # disabled
ma_7 = MassAddition(Input=crv_cp.Distance)  # -> Result, PartialResults; disabled
division_12 = Division(A=ma_7.Result, B=lng_8)  # disabled

preview_4 = CustomPreview(Geometry=pt_5, Material=swatch_5)  # disabled
vec2pt = Vector2Pt(PointA=pt_5, PointB=crv_cp.Point, Unitize=False)  # -> Vector, Length; disabled
sort_4 = SortList(Keys=vec2pt.Length, ValuesA=vec2pt.Vector)  # -> Keys, ValuesA; disabled
vdis = VectorDisplay(Anchor=pt_5, Vector=vec2pt.Vector)  # disabled
item_15 = ListItem(List=sort_4.ValuesA, Index=panel_17, Wrap=True)  # disabled

density_no_voids = Data(division_12)  # disabled

# ---- group: Envelope Area
debrep_6 = DeconstructBrep(Brep=join_5.Breps)  # -> Faces, Edges, Vertices; disabled
area_19 = Area(Geometry=debrep_6.Faces)  # -> Area, Centroid; disabled

# ----
trim_3 = TrimTree(Tree=area_19.Area, Depth=1)  # disabled

# ---- group: Envelope Area (continued)
ma_8 = MassAddition(Input=trim_3)  # -> Result, PartialResults; disabled
subtraction_2 = Subtraction(A=ma_8.Result, B=area_13.Area)  # disabled
panel_106 = Panel(subtraction_2)  # disabled

# ---- group: Wall Area
subtraction_3 = Subtraction(A=subtraction_2, B=area_13.Area)  # disabled
panel_107 = Panel(subtraction_3)  # disabled

# ----
wall_area = Data(subtraction_3)  # disabled
building_envelope_area = Data(subtraction_2)  # disabled

minbb3d = MinimumBoundingBox3D(Content=sort_3.ValuesA)  # disabled
debox = DeconstructBox(Box=minbb3d)  # -> Plane, X, Y, Z; disabled
merge_7 = Merge(Data1=debox.X, Data2=debox.Y, Data3=debox.Z)  # disabled

trim_4 = TrimTree(Tree=merge_7, Depth=1)  # disabled
panel_108 = Panel(trim_4)  # disabled

dedomain_2 = DeconstructDomain(Domain=trim_4)  # -> Start, End; disabled
subtraction_4 = Subtraction(A=dedomain_2.End, B=dedomain_2.Start)  # disabled
panel_109 = Panel(subtraction_4)  # disabled

# ---- group: MBR Height
panel_110 = Panel("1")  # disabled
item_16 = ListItem(List=subtraction_4, Index=panel_110, Wrap=True)  # disabled
panel_111 = Panel(item_16)  # disabled

# ---- group: MBR Lenegth
panel_112 = Panel("0")  # disabled
item_17 = ListItem(List=subtraction_4, Index=panel_112, Wrap=True)  # disabled
panel_113 = Panel(item_17)  # disabled

# ---- group: MBR Width
panel_114 = Panel("2")  # disabled
item_18 = ListItem(List=subtraction_4, Index=panel_114, Wrap=True)  # disabled
panel_115 = Panel(item_18)  # disabled

# ----
merge_8 = Merge(Data1=item_17, Data2=item_18)  # disabled
extremums = MinMax(Number=merge_8)  # -> Minimum, Maximum; disabled
panel_116 = Panel(extremums.Minimum)  # disabled

mbr_length = Data(extremums.Maximum)  # disabled
mbr_width = Data(extremums.Minimum)  # disabled
mbr_height = Data(item_16)  # disabled

graft = GraftTree(Tree=pt_4, IncludeEmptyLists=True, IncludeNullItems=True)  # disabled

# ---- group: Vertice Angles
end = EndPoints(Curve=debrep_5.Edges)  # -> Start, End; disabled
ln = Line(StartPoint=end.Start, EndPoint=end.End)  # disabled
shift_11 = ShiftList(List=ln, Shift=1, Wrap=True)  # disabled
angle = Angle(VectorA=ln, VectorB=shift_11)  # -> Angle, Reflex; disabled
deg_2 = Degrees(Radians=angle.Angle)  # -> simplify(Degrees); disabled

# ----
ma_9 = MassAddition(Input=deg_2)  # -> Result, PartialResults; disabled

vertice_angles = Data(ma_9.Result)  # disabled

# ----
# Perimeter Distance
# Area
# Volume
# No. of Vertices
# Vertice Angles
# Building Envelope Area
# Wall Area
# MBR Height
# MBR Length
# MBR Width
# Building With Voids
# Compactness
merge_9 = Merge(
    Data1=footprint_srf,
    Data2=perimeter_distance,
    Data3=footprint_area_2,
    Data4=volume_2,
    Data5=no_of_vertices,
    Data6=vertice_angles,
    Data7=building_envelope_area,
    Data8=wall_area,
    Data9=mbr_height,
    Data10=mbr_length,
    Data11=mbr_width,
    Data12=buildings_with_voids,
    Data13=compactness)  # disabled
panel_117 = Panel(merge_9)  # disabled

# ---- group: Vertice Angles (continued)
panel_118 = Panel(ma_9.Result)  # disabled

# ----
pt_6 = Point(graft)  # disabled

incurve_3 = PointInCurve(Point=pt_6, Curve=cull_i)  # -> Relationship, Point; disabled
ma_10 = MassAddition(Input=incurve_3.Relationship)  # -> Result, PartialResults; disabled
dispatch_24 = Dispatch(List=pt_6, DispatchPattern=ma_10.Result)  # -> ListA, ListB; disabled
pt_7 = Point(dispatch_24.ListB)  # disabled
flatten = FlattenTree(Tree=pt_7, Path="{0}")  # disabled

preview_5 = CustomPreview(Geometry=pt_7, Material=swatch_6)  # disabled

data_13 = Data(split_2.Positive)  # disabled
crv_cp_2 = CurveClosestPoint(Point=pt_7, Curve=data_13)  # -> Point, Parameter, Distance; disabled
flip = FlipMatrix(Data=crv_cp_2.Distance)  # disabled
panel_119 = Panel("0")  # disabled

vec2pt_2 = Vector2Pt(PointA=pt_7, PointB=crv_cp_2.Point, Unitize=False)  # -> Vector, Length; disabled
vec2pt_3 = Vector2Pt(PointA=pt_7, PointB=crv_cp_2.Point, Unitize=False)  # -> Vector, Length; disabled
sort_5 = SortList(Keys=vec2pt_2.Length, ValuesA=vec2pt_2.Vector)  # -> Keys, ValuesA; disabled
sort_6 = SortList(Keys=vec2pt_3.Length, ValuesA=vec2pt_3.Vector)  # -> Keys, ValuesA; disabled
item_19 = ListItem(List=sort_5.ValuesA, Index=panel_18, Wrap=True)  # disabled
vdis_2 = VectorDisplay(Anchor=pt_7, Vector=item_19)  # disabled
item_20 = ListItem(List=sort_6.ValuesA, Index=panel_19, Wrap=True)  # disabled
vdis_3 = VectorDisplay(Anchor=pt_7, Vector=item_20)  # disabled

sort_7 = SortList(Keys=crv_cp_2.Distance, ValuesA=crv_cp_2.Distance)  # -> Keys, ValuesA; disabled

item_21 = ListItem(List=sort_7.ValuesA, Index=panel_119, Wrap=True)  # disabled

nullrep_5 = ReplaceNulls(Items=item_21, Replacements=panel_90)  # -> Items, Count; disabled

path_mapper_2 = PathMapper(nullrep_5.Items, source="{A;B;C;D}", target="{A}")  # disabled
path_mapper_3 = PathMapper(pt_7, source="{A;B;C;D}", target="{A}")  # disabled

ma_11 = MassAddition(Input=path_mapper_2)  # -> Result, PartialResults; disabled

lng_9 = ListLength(List=path_mapper_3)  # disabled
division_13 = Division(A=ma_11.Result, B=lng_9)  # disabled
density = Data(division_13)  # disabled

panel_120 = Panel(density)  # disabled

merge_10 = Merge(Data1=density, Data2=density_no_voids)  # disabled
density_2 = Data(merge_10)  # disabled
panel_121 = Panel(density_2)  # disabled

panel_122 = Panel("3.5")  # disabled
division_14 = Division(A=item_8, B=panel_122)  # disabled
panel_123 = Panel("2")  # disabled
panel_124 = Panel("0")  # disabled
roundd_2 = RoundToDecimalPlace(NumberX=division_14, DecimalPlace=panel_124, RoundType=panel_123)  # -> Rounded, Difference; disabled
ma_12 = MassAddition(Input=roundd_2.Rounded)  # -> Result, PartialResults; disabled

av_number_of_floors = Data(ma_12.Result)  # disabled
join_7 = TextJoin(Text=av_number_of_floors, Join=",")  # disabled

panel_125 = Panel(join_7)  # disabled

len_3 = Length(Curve=item_6)  # disabled

perimeter = Data(len_3)  # disabled

panel_126 = Panel(perimeter)  # disabled

boundary_11 = BoundarySurfaces(Edges=item_6)  # disabled
number_slider_5 = Slider(0.25, range=0..1)  # disabled
number_slider_6 = Slider(0.659, range=0..1)  # disabled
number_slider_7 = Slider(2, range=0..6)  # disabled
panel_127 = Panel("2")  # disabled

debrep_7 = DeconstructBrep(Brep=boundary_11)  # -> Faces, Edges, Vertices; disabled
cir_2 = Circle(Plane=debrep_7.Vertices, Radius=2)  # disabled
trim_5 = TrimWithRegion(Curve=cir_2, Region=debrep_7.Faces)  # -> Inside, Outside; disabled
crv_18 = Curve(trim_5.Inside)  # disabled
path_mapper_4 = PathMapper(crv_18, source="{A;B;C}", target="{A}")  # disabled
darc_2 = DeconstructArc(Arc=path_mapper_4)  # -> BasePlane, Radius, Angle; disabled
deg_3 = Degrees(Radians=darc_2.Angle)  # disabled

vertex_angles_2 = Data(simplify(deg_3))  # disabled
join_8 = TextJoin(Text=vertex_angles_2)  # disabled

panel_128 = Panel("90")  # disabled
larger_12 = LargerThan(FirstNumber=vertex_angles_2, SecondNumber=panel_128)  # -> LargerThan, OrEqualTo; disabled
dispatch_25 = Dispatch(List=vertex_angles_2, DispatchPattern=larger_12.OrEqualTo)  # -> ListA, ListB; disabled
panel_129 = Panel("135")  # disabled
smaller_9 = SmallerThan(FirstNumber=dispatch_25.ListA, SecondNumber=panel_129)  # -> SmallerThan, OrEqualTo; disabled
dispatch_26 = Dispatch(List=dispatch_25.ListA, DispatchPattern=smaller_9.OrEqualTo)  # -> ListA, ListB; disabled
panel_130 = Panel("180")  # disabled
_90_to_135_2 = Data(dispatch_26.ListA)  # disabled
smaller_10 = SmallerThan(FirstNumber=dispatch_26.ListB, SecondNumber=panel_130)  # -> SmallerThan, OrEqualTo; disabled

panel_131 = Panel("270")  # disabled
larger_13 = LargerThan(FirstNumber=vertex_angles_2, SecondNumber=panel_131)  # -> LargerThan, OrEqualTo; disabled
dispatch_27 = Dispatch(List=vertex_angles_2, DispatchPattern=larger_13.OrEqualTo)  # -> ListA, ListB; disabled
panel_132 = Panel("315")  # disabled
smaller_11 = SmallerThan(FirstNumber=dispatch_27.ListA, SecondNumber=panel_132)  # -> SmallerThan, OrEqualTo; disabled
dispatch_28 = Dispatch(List=dispatch_27.ListA, DispatchPattern=smaller_11.OrEqualTo)  # -> ListA, ListB; disabled
_270_to_315_2 = Data(dispatch_28.ListA)  # disabled

panel_134 = Panel("89.999999")  # disabled
smaller_12 = SmallerThan(FirstNumber=vertex_angles_2, SecondNumber=panel_134)  # -> SmallerThan, OrEqualTo; disabled
dispatch_29 = Dispatch(List=vertex_angles_2, DispatchPattern=smaller_12.SmallerThan)  # -> ListA, ListB; disabled
panel_135 = Panel("45")  # disabled
larger_14 = LargerThan(FirstNumber=dispatch_29.ListA, SecondNumber=panel_135)  # -> LargerThan, OrEqualTo; disabled
dispatch_30 = Dispatch(List=dispatch_29.ListA, DispatchPattern=larger_14.OrEqualTo)  # -> ListA, ListB; disabled
_90_to_45_2 = Data(dispatch_30.ListA)  # disabled
_0_to_45_2 = Data(dispatch_30.ListB)  # disabled

panel_136 = Panel("10")  # disabled
panel_137 = Panel("0.1")  # disabled
panel_138 = Panel("89.999999")  # disabled
panel_139 = Panel("45")  # disabled
dom_17 = ConstructDomain(DomainStart=panel_138, DomainEnd=panel_139)  # disabled
dom_18 = ConstructDomain(DomainStart=panel_137, DomainEnd=panel_136)  # disabled
remap_10 = RemapNumbers(Value=_90_to_45_2, Source=dom_17, Target=dom_18)  # -> Mapped, Clipped; disabled

panel_140 = Panel("0.1")  # disabled
panel_141 = Panel("10")  # disabled
panel_142 = Panel("0")  # disabled
panel_143 = Panel("44.999999")  # disabled
dom_19 = ConstructDomain(DomainStart=panel_142, DomainEnd=panel_143)  # disabled
dom_20 = ConstructDomain(DomainStart=panel_140, DomainEnd=panel_141)  # disabled
remap_11 = RemapNumbers(Value=_0_to_45_2, Source=dom_19, Target=dom_20)  # -> Mapped, Clipped; disabled

panel_144 = Panel("10")  # disabled
panel_145 = Panel("0.1")  # disabled
panel_146 = Panel("90")  # disabled
panel_147 = Panel("135")  # disabled
dom_21 = ConstructDomain(DomainStart=panel_146, DomainEnd=panel_147)  # disabled
dom_22 = ConstructDomain(DomainStart=panel_145, DomainEnd=panel_144)  # disabled
remap_12 = RemapNumbers(Value=_90_to_135_2, Source=dom_21, Target=dom_22)  # -> Mapped, Clipped; disabled

panel_148 = Panel("10")  # disabled
panel_149 = Panel("0.1")  # disabled
panel_150 = Panel("270.111111")  # disabled
panel_151 = Panel("315")  # disabled
dom_23 = ConstructDomain(DomainStart=panel_150, DomainEnd=panel_151)  # disabled
dom_24 = ConstructDomain(DomainStart=panel_149, DomainEnd=panel_148)  # disabled
remap_13 = RemapNumbers(Value=_270_to_315_2, Source=dom_23, Target=dom_24)  # -> Mapped, Clipped; disabled

number_slider_8 = Slider(4, range=0..10)  # disabled
panel_152 = Panel("0")  # disabled

multiplication_2 = Multiplication(A=len_3, B=item_8)  # disabled

wall_area_2 = Data(multiplication_2)  # disabled
join_9 = TextJoin(Text=wall_area_2, Join=",")  # disabled

panel_153 = Panel(wall_area_2)  # disabled

debrep_8 = DeconstructBrep(Brep=boundary_6)  # -> Faces, Edges, Vertices; disabled
lng_10 = ListLength(List=debrep_8.Vertices)  # disabled
path_mapper_5 = PathMapper(lng_10, source="{A;B}", target="{A}")  # disabled

ma_13 = MassAddition(Input=path_mapper_5)  # -> Result, PartialResults; disabled
vertex_number_2 = Data(ma_13.Result)  # disabled
join_10 = TextJoin(Text=vertex_number_2, Join=",")  # disabled

panel_154 = Panel(vertex_number_2)  # disabled

area_20 = Area(Geometry=item_6)  # -> Area, Centroid; disabled

lng_11 = ListLength(List=polylines_2)  # disabled
panel_155 = Panel("1")  # disabled
larger_15 = LargerThan(FirstNumber=lng_11, SecondNumber=panel_155)  # -> LargerThan, OrEqualTo; disabled

void_2 = Data(simplify(larger_15.LargerThan))  # disabled
join_11 = TextJoin(Text=void_2)  # disabled

panel_156 = Panel(void_2)  # disabled

disc_3 = Discontinuity(Curve=item_6, Level=1)  # -> Points, Parameters

ma_14 = MassAddition(Input=area_6.Area)  # -> Result, PartialResults; disabled

area_21 = Data(simplify(ma_14.Result))  # disabled
join_12 = TextJoin(Text=area_21, Join=",")  # disabled

panel_157 = Panel(area_21)  # disabled

division_15 = Division(A=perimeter, B=area_21)  # disabled
per_area = Data(division_15)  # disabled

panel_158 = Panel(per_area)  # disabled
subtraction_5 = Subtraction(A=area_21, B=ma_5.Result)  # disabled
data_14 = Data(subtraction_5)  # disabled
panel_159 = Panel(data_14)  # disabled

multiplication_3 = Multiplication(A=area_21, B=item_8)  # disabled
ma_15 = MassAddition(Input=multiplication_3)  # -> Result, PartialResults; disabled

volume_3 = Data(multiplication_3)  # disabled
join_13 = TextJoin(Text=volume_3, Join=",")  # disabled

panel_160 = Panel(volume_3)  # disabled

division_16 = Division(A=item_8, B=area_21)  # disabled
roundd_3 = RoundToDecimalPlace(NumberX=division_16, DecimalPlace=number_slider_8, RoundType=panel_152)  # -> Rounded, Difference; disabled
ma_16 = MassAddition(Input=roundd_3.Rounded)  # -> Result, PartialResults; disabled

height_area_ratio = Data(ma_16.Result)  # disabled
join_14 = TextJoin(Text=height_area_ratio, Join=",")  # disabled

panel_161 = Panel(height_area_ratio)  # disabled

division_17 = Division(A=area_21, B=area_20.Area)  # disabled
ma_17 = MassAddition(Input=division_17)  # -> Result, PartialResults; disabled

void_area_2 = Data(ma_17.Result)  # disabled
join_15 = TextJoin(Text=void_area_2)  # disabled

panel_162 = Panel(void_area_2)  # disabled

addition_2 = Addition(A=wall_area_2, B=area_21)  # disabled

# ---- group: Data
envelope_area = Data(addition_2)  # disabled
join_16 = TextJoin(Text=envelope_area, Join=",")  # disabled

# ----
panel_163 = Panel(envelope_area)  # disabled

explode_3 = Explode(Curve=item_6, Recursive=True)  # -> Segments, Vertices; disabled
len_4 = Length(Curve=explode_3.Segments)  # disabled
lng_12 = ListLength(List=explode_3.Vertices)  # disabled
ma_18 = MassAddition(Input=len_4)  # -> Result, PartialResults; disabled
division_18 = Division(A=ma_18.Result, B=lng_12)  # -> simplify(Result); disabled
subtraction_6 = Subtraction(A=division_18, B=len_4)  # disabled
sqr_4 = Square(Value=subtraction_6)  # disabled
ma_19 = MassAddition(Input=sqr_4)  # -> Result, PartialResults; disabled
division_19 = Division(A=ma_19.Result, B=lng_12)  # -> simplify(Result); disabled
sqrt_2 = SquareRoot(Value=division_19)  # disabled

segments_av = Data(division_18)  # disabled

segments_std = Data(sqrt_2)  # disabled

panel_164 = Panel(segments_std)  # disabled
panel_165 = Panel(segments_av)  # disabled

area_22 = Area(Geometry=boundary_6)  # -> Area, Centroid

arcdim_2 = ArcDimension(Arc=crv_18, Offset=number_slider_5, Text="{0:0.0}°", Size=number_slider_6)  # disabled
_315_to_360_2 = Data(dispatch_28.ListB)  # disabled
dispatch_31 = Dispatch(List=dispatch_26.ListB, DispatchPattern=smaller_10.SmallerThan)  # -> ListA, ListB; disabled

panel_166 = Panel("360")  # disabled
panel_167 = Panel("315.111111")  # disabled
panel_168 = Panel("10")  # disabled
panel_169 = Panel("0.1")  # disabled
dom_25 = ConstructDomain(DomainStart=panel_167, DomainEnd=panel_166)  # disabled
dom_26 = ConstructDomain(DomainStart=panel_169, DomainEnd=panel_168)  # disabled
remap_14 = RemapNumbers(Value=_315_to_360_2, Source=dom_25, Target=dom_26)  # -> Mapped, Clipped; disabled

panel_170 = Panel("10")  # disabled
panel_171 = Panel("0.1")  # disabled
panel_172 = Panel("180")  # disabled
panel_173 = Panel("135.111111")  # disabled
dom_27 = ConstructDomain(DomainStart=panel_172, DomainEnd=panel_173)  # disabled
dom_28 = ConstructDomain(DomainStart=panel_171, DomainEnd=panel_170)  # disabled
remap_15 = RemapNumbers(Value=dispatch_31.ListA, Source=dom_27, Target=dom_28)  # -> Mapped, Clipped; disabled

explode_4 = Explode(Curve=item_6, Recursive=True)  # -> Segments, simplify(Vertices)
area_23 = Area(Geometry=item_6)  # -> Area, Centroid
minbb2d_3 = MinimumBoundingBox2D(Points=explode_4.Vertices, Plane=area_23.Centroid)
explode_5 = Explode(Curve=minbb2d_3, Recursive=True)  # -> Segments, Vertices
area_24 = Area(Geometry=minbb2d_3)  # -> Area, Centroid
len_5 = Length(Curve=explode_5.Segments)
extremums_2 = MinMax(Number=simplify(len_5))  # -> Minimum, Maximum
mbr_area = Data(area_24.Area)
panel_174 = Panel(mbr_area)

rdiff = RegionDifference(CurvesA=minbb2d_3, CurvesB=item_6)
lng_13 = ListLength(List=rdiff)
ma_20 = MassAddition(Input=lng_13)  # -> Result, PartialResults
addition_3 = Addition(A=ma_20.Result, B="1")
no_of_intrusions_1 = Data(simplify(addition_3))
panel_175 = Panel(no_of_intrusions_1)

area_25 = Area(Geometry=rdiff)  # -> Area, Centroid
item_22 = ListItem(List=flatten(minbb2d_3), Index=panel_21, Wrap=True)  # disabled

mbr_width_2 = Data(simplify(extremums_2.Minimum))
mbr_length_2 = Data(extremums_2.Maximum)

division_20 = Division(A=mbr_length_2, B=mbr_width_2)
mbr_l_w = Data(division_20)
panel_176 = Panel(mbr_length_2)
panel_177 = Panel(mbr_width_2)
panel_178 = Panel(mbr_l_w)

area_26 = Area(Geometry=boundary_6)  # -> Area, Centroid; disabled
division_21 = Division(A=area_26.Area, B=mbr_l_w)  # disabled
sqrt_3 = SquareRoot(Value=division_21)  # disabled
multiplication_4 = Multiplication(A=sqrt_3, B=mbr_l_w)  # disabled
len_6 = Length(Curve=diagram_polylines_2)  # disabled
rectangle = Rectangle(Plane=PlaneXY(0, 0, 0), XSize=sqrt_3, YSize=multiplication_4, Radius=0)  # -> Rectangle, Length; disabled
ma_21 = MassAddition(Input=len_6)  # -> Result, PartialResults; disabled
division_22 = Division(A=ma_21.Result, B=rectangle.Length)  # disabled
eri = Data(division_22)  # disabled
panel_179 = Panel(eri)  # disabled

data_15 = Data(minbb2d_3)
incurve_4 = PointInCurve(Point=disc_3.Points, Curve=data_15)  # -> Relationship, Point
equals = Equality(FirstNumber=incurve_4.Relationship, SecondNumber="1")  # -> Equality, Inequality
dispatch_32 = Dispatch(List=disc_3.Points, DispatchPattern=equals.Equality)  # -> ListA, ListB
lng_14 = ListLength(List=dispatch_32.ListA)  # -> simplify(Length)

division_23 = Division(A=lng_14, B=vertex_number_2)

point_on_bbox = Data(division_23)
panel_180 = Panel(point_on_bbox)

area_27 = Area(Geometry=minbb2d_3)  # -> Area, Centroid
division_24 = Division(A=area_22.Area, B=area_27.Area)

bboxarea_area = Data(division_24)

panel_181 = Panel(bboxarea_area)

item_23 = ListItem(List=split_4.Positive, Index=0, Wrap=True)  # disabled
area_28 = Area(Geometry=item_23)  # -> Area, Centroid; disabled
area_29 = Area(Geometry=split_4.Negative)  # -> Area, Centroid; disabled

panel_182 = Panel("269.999999")  # disabled
smaller_13 = SmallerThan(FirstNumber=vertex_angles_2, SecondNumber=panel_182)  # -> SmallerThan, OrEqualTo; disabled
dispatch_33 = Dispatch(List=vertex_angles_2, DispatchPattern=smaller_13.SmallerThan)  # -> ListA, ListB; disabled
panel_183 = Panel("225")  # disabled
larger_16 = LargerThan(FirstNumber=dispatch_33.ListA, SecondNumber=panel_183)  # -> LargerThan, OrEqualTo; disabled
dispatch_34 = Dispatch(List=dispatch_33.ListA, DispatchPattern=larger_16.OrEqualTo)  # -> ListA, ListB; disabled
panel_184 = Panel("180")  # disabled
larger_17 = LargerThan(FirstNumber=dispatch_34.ListB, SecondNumber=panel_184)  # -> LargerThan, OrEqualTo; disabled
_225_to_270_2 = Data(dispatch_34.ListA)  # disabled

panel_185 = Panel("225")  # disabled
panel_186 = Panel("269.999999")  # disabled
panel_187 = Panel("10")  # disabled
panel_188 = Panel("0.1")  # disabled
dom_29 = ConstructDomain(DomainStart=panel_185, DomainEnd=panel_186)  # disabled
dom_30 = ConstructDomain(DomainStart=panel_188, DomainEnd=panel_187)  # disabled
remap_16 = RemapNumbers(Value=_225_to_270_2, Source=dom_29, Target=dom_30)  # -> Mapped, Clipped; disabled

disc_4 = Discontinuity(Curve=item_23, Level=1)  # -> simplify(Points), Parameters; disabled
voxel_size = Slider(3, range=0..10)  # disabled
minbb2d_4 = MinimumBoundingBox2D(Points=disc_4.Points, Plane=area_28.Centroid)  # disabled
srf = Surface(minbb2d_4)  # disabled
dim_3 = Dimensions(Surface=srf)  # -> UDimension, VDimension; disabled
merge_11 = Merge(Data1=dim_3.UDimension, Data2=dim_3.VDimension)  # disabled
extremums_3 = MinMax(Number=merge_11)  # -> Minimum, Maximum; disabled
division_25 = Division(A=extremums_3.Minimum, B=voxel_size)  # disabled
division_26 = Division(A=extremums_3.Maximum, B=voxel_size)  # disabled
panel_189 = Panel("2")  # disabled
number_slider_9 = Slider(1.5, range=0..10)  # disabled
panel_190 = Panel("1")  # disabled
round = Round(Number=division_25)  # -> Nearest, Floor, Ceiling; disabled
number_slider_10 = Slider(1.5, range=0..10)  # disabled
round_2 = Round(Number=division_26)  # -> Nearest, Floor, Ceiling; disabled
series = Series(Start=0, Step=voxel_size, Count=round_2.Ceiling)  # disabled
series_2 = Series(Start=0, Step=voxel_size, Count=round.Ceiling)  # disabled
addition_4 = Addition(A=series_2, B=number_slider_9)  # disabled
addition_5 = Addition(A=series, B=number_slider_10)  # disabled

disc_5 = Discontinuity(Curve=minbb2d_4, Level=1)  # -> simplify(Points), Parameters; disabled
item_24 = ListItem(List=disc_5.Points, Index=0, Wrap=True)  # disabled
dist_2 = Distance(PointA=item_24, PointB=disc_5.Points)  # disabled
sort_8 = SortList(Keys=dist_2, ValuesA=disc_5.Points)  # -> Keys, ValuesA; disabled

item_25 = ListItem(List=sort_8.ValuesA, Index=panel_189, Wrap=True)  # disabled
item_26 = ListItem(List=sort_8.ValuesA, Index=panel_190, Wrap=True)  # disabled
vec2pt_4 = Vector2Pt(PointA=item_24, PointB=item_25, Unitize=False)  # -> Vector, Length; disabled
vec2pt_5 = Vector2Pt(PointA=item_24, PointB=item_26, Unitize=False)  # -> Vector, Length; disabled
amp = Amplitude(Vector=vec2pt_4.Vector, Amplitude=addition_5)  # disabled
amp_2 = Amplitude(Vector=vec2pt_5.Vector, Amplitude=addition_4)  # disabled
move = Move(Geometry=item_24, Motion=amp)  # -> Geometry, Transform; disabled
crossref = CrossReference(ListA=move.Geometry, ListB=amp_2, CrossMode=1)  # -> ListA, ListB; disabled
move_2 = Move(Geometry=crossref.ListA, Motion=crossref.ListB)  # -> simplify(Geometry), Transform; disabled
incurve_5 = PointInCurve(Point=move_2.Geometry, Curve=item_23)  # -> Relationship, Point; disabled
dispatch_35 = Dispatch(List=move_2.Geometry, DispatchPattern=incurve_5.Relationship)  # -> ListA, ListB; disabled
pt_8 = Point(dispatch_35.ListA)  # disabled
incurve_6 = PointInCurve(Point=pt_8, Curve=item_23)  # -> Relationship, Point; disabled
dispatch_36 = Dispatch(List=pt_8, DispatchPattern=incurve_6.Relationship)  # -> ListA, ListB; disabled
pt_9 = Point(dispatch_36.ListA)  # disabled

disc_6 = Discontinuity(Curve=split_4.Negative, Level=1)  # -> simplify(Points), Parameters; disabled
voxel_size_2 = Slider(3, range=0..10)  # disabled
minbb2d_5 = MinimumBoundingBox2D(Points=disc_6.Points, Plane=area_29.Centroid)  # disabled
srf_2 = Surface(minbb2d_5)  # disabled
number_slider_11 = Slider(6, range=0..10)  # disabled
dim_4 = Dimensions(Surface=srf_2)  # -> UDimension, VDimension; disabled
merge_12 = Merge(Data1=dim_4.UDimension, Data2=dim_4.VDimension)  # disabled
extremums_4 = MinMax(Number=merge_12)  # -> Minimum, Maximum; disabled
division_27 = Division(A=extremums_4.Minimum, B=voxel_size_2)  # disabled
division_28 = Division(A=extremums_4.Maximum, B=voxel_size_2)  # disabled
panel_191 = Panel("2")  # disabled
number_slider_12 = Slider(1.5, range=0..10)  # disabled
panel_192 = Panel("1")  # disabled
round_3 = Round(Number=division_27)  # -> Nearest, Floor, Ceiling; disabled
number_slider_13 = Slider(1.5, range=0..10)  # disabled
round_4 = Round(Number=division_28)  # -> Nearest, Floor, Ceiling; disabled
series_3 = Series(Start=0, Step=voxel_size_2, Count=round_4.Ceiling)  # disabled
series_4 = Series(Start=0, Step=voxel_size_2, Count=round_3.Ceiling)  # disabled
addition_6 = Addition(A=series_4, B=number_slider_12)  # disabled
addition_7 = Addition(A=series_3, B=number_slider_13)  # disabled

disc_7 = Discontinuity(Curve=minbb2d_5, Level=1)  # -> simplify(Points), Parameters; disabled
item_27 = ListItem(List=disc_7.Points, Index=0, Wrap=True)  # disabled
dist_3 = Distance(PointA=item_27, PointB=disc_7.Points)  # disabled
sort_9 = SortList(Keys=dist_3, ValuesA=disc_7.Points)  # -> Keys, ValuesA; disabled

points = PointList(Points=sort_9.ValuesA, Size=number_slider_11)  # disabled
item_28 = ListItem(List=sort_9.ValuesA, Index=panel_191, Wrap=True)  # disabled
item_29 = ListItem(List=sort_9.ValuesA, Index=panel_192, Wrap=True)  # disabled
vec2pt_6 = Vector2Pt(PointA=item_27, PointB=item_28, Unitize=False)  # -> Vector, Length; disabled
vec2pt_7 = Vector2Pt(PointA=item_27, PointB=item_29, Unitize=False)  # -> Vector, Length; disabled
amp_3 = Amplitude(Vector=vec2pt_6.Vector, Amplitude=addition_7)  # disabled
amp_4 = Amplitude(Vector=vec2pt_7.Vector, Amplitude=addition_6)  # disabled
move_3 = Move(Geometry=item_27, Motion=amp_3)  # -> Geometry, Transform; disabled
crossref_2 = CrossReference(ListA=move_3.Geometry, ListB=amp_4, CrossMode=1)  # -> ListA, ListB; disabled
move_4 = Move(Geometry=crossref_2.ListA, Motion=crossref_2.ListB)  # -> Geometry, Transform; disabled
incurve_7 = PointInCurve(Point=move_4.Geometry, Curve=split_4.Negative)  # -> Relationship, Point; disabled
dispatch_37 = Dispatch(List=move_4.Geometry, DispatchPattern=incurve_7.Relationship)  # -> ListA, ListB; disabled
pt_10 = Point(simplify(dispatch_37.ListA))  # disabled

swatch_7 = ColourSwatch(SwatchColor=RGBA(0, 0, 255, 80))  # disabled
preview_6 = CustomPreview(Geometry=pt_10, Material=swatch_7)  # disabled
crv_cp_3 = CurveClosestPoint(Point=pt_10, Curve=split_4.Negative)  # -> Point, Parameter, Distance; disabled
lng_15 = ListLength(List=pt_10)  # disabled
ma_22 = MassAddition(Input=crv_cp_3.Distance)  # -> Result, PartialResults; disabled
vec2pt_8 = Vector2Pt(PointA=pt_10, PointB=crv_cp_3.Point, Unitize=False)  # -> Vector, Length; disabled
division_29 = Division(A=ma_22.Result, B=lng_15)  # disabled
vdis_4 = VectorDisplay(Anchor=pt_10, Vector=vec2pt_8.Vector)  # disabled
density_no_voids_2 = Data(simplify(division_29))  # disabled

dispatch_38 = Dispatch(List=dispatch_34.ListB, DispatchPattern=larger_17.LargerThan)  # -> ListA, ListB; disabled

_180_to_225_2 = Data(dispatch_38.ListA)  # disabled

panel_193 = Panel("0.1")  # disabled
panel_194 = Panel("10")  # disabled
panel_195 = Panel("180.111111")  # disabled
panel_196 = Panel("224.999999")  # disabled
dom_31 = ConstructDomain(DomainStart=panel_196, DomainEnd=panel_195)  # disabled
dom_32 = ConstructDomain(DomainStart=panel_193, DomainEnd=panel_194)  # disabled
remap_17 = RemapNumbers(Value=_180_to_225_2, Source=dom_31, Target=dom_32)  # -> Mapped, Clipped; disabled

merge_13 = Merge(
    Data1=remap_12.Mapped,
    Data2=remap_15.Mapped,
    Data3=remap_10.Mapped,
    Data4=remap_11.Mapped,
    Data5=remap_17.Mapped,
    Data6=remap_16.Mapped,
    Data7=remap_14.Mapped,
    Data8=remap_13.Mapped)  # disabled
roundd_4 = RoundToDecimalPlace(NumberX=merge_13, DecimalPlace=number_slider_7, RoundType=panel_127)  # -> Rounded, Difference; disabled
ma_23 = MassAddition(Input=roundd_4.Rounded)  # -> Result, PartialResults; disabled
division_30 = Division(A=ma_23.Result, B=ma_13.Result)  # disabled

vertex_complexity_2 = Data(division_30)  # disabled

panel_197 = Panel(vertex_complexity_2)  # disabled

graft_2 = GraftTree(Tree=pt_8, IncludeEmptyLists=True, IncludeNullItems=True)  # disabled
panel_198 = Panel("0")  # disabled
cull_i_4 = CullIndex(List=split_4.Positive, Indices=panel_198, Wrap=True)  # disabled

pt_11 = Point(graft_2)  # disabled

incurve_8 = PointInCurve(Point=pt_11, Curve=cull_i_4)  # -> Relationship, Point; disabled
ma_24 = MassAddition(Input=incurve_8.Relationship)  # -> Result, PartialResults; disabled
dispatch_39 = Dispatch(List=pt_11, DispatchPattern=ma_24.Result)  # -> ListA, ListB; disabled
pt_12 = Point(dispatch_39.ListB)  # disabled
flatten_2 = FlattenTree(Tree=pt_12, Path="{0}")  # disabled

data_16 = Data(split_4.Positive)  # disabled
crv_cp_4 = CurveClosestPoint(Point=pt_12, Curve=data_16)  # -> Point, Parameter, Distance; disabled
sort_10 = SortList(Keys=crv_cp_4.Distance, ValuesA=crv_cp_4.Distance)  # -> Keys, ValuesA; disabled
path_mapper_6 = PathMapper(pt_12, source="{A;B}", target="{A}")  # disabled
panel_199 = Panel("0")  # disabled
item_30 = ListItem(List=sort_10.ValuesA, Index=panel_199, Wrap=True)  # disabled
lng_16 = ListLength(List=path_mapper_6)  # disabled
panel_200 = Panel("0")  # disabled
nullrep_6 = ReplaceNulls(Items=item_30, Replacements=panel_200)  # -> Items, Count; disabled
path_mapper_7 = PathMapper(nullrep_6.Items, source="{A;B}", target="{A}")  # disabled
ma_25 = MassAddition(Input=path_mapper_7)  # -> Result, PartialResults; disabled
division_31 = Division(A=ma_25.Result, B=lng_16)  # disabled
density_3 = Data(division_31)  # disabled

swatch_8 = ColourSwatch(SwatchColor=RGBA(0, 0, 255, 80))  # disabled
preview_7 = CustomPreview(Geometry=pt_12, Material=swatch_8)  # disabled
vec2pt_9 = Vector2Pt(PointA=pt_12, PointB=crv_cp_4.Point, Unitize=False)  # -> Vector, Length; disabled
vec2pt_10 = Vector2Pt(PointA=pt_12, PointB=crv_cp_4.Point, Unitize=False)  # -> Vector, Length; disabled
sort_11 = SortList(Keys=vec2pt_9.Length, ValuesA=vec2pt_9.Vector)  # -> Keys, ValuesA; disabled
sort_12 = SortList(Keys=vec2pt_10.Length, ValuesA=vec2pt_10.Vector)  # -> Keys, ValuesA; disabled
panel_201 = Panel("0")  # disabled
panel_202 = Panel("0")  # disabled
item_31 = ListItem(List=sort_11.ValuesA, Index=panel_201, Wrap=True)  # disabled
vdis_5 = VectorDisplay(Anchor=pt_12, Vector=item_31)  # disabled
item_32 = ListItem(List=sort_12.ValuesA, Index=panel_202, Wrap=True)  # disabled
vdis_6 = VectorDisplay(Anchor=pt_12, Vector=item_32)  # disabled

merge_14 = Merge(Data1=density_3, Data2=density_no_voids_2)  # disabled
density_4 = Data(simplify(merge_14))  # disabled
panel_203 = Panel(density_4)  # disabled

merge_15 = Merge(
    Data1=osm_id_2,
    Data2=point_x,
    Data3=point_y,
    Data4=age,
    Data5=height_3,
    Data6=area_21,
    Data7=volume_3,
    Data8=mbr_length_2,
    Data9=mbr_width_2,
    Data10=mbr_l_w,
    Data11=perimeter,
    Data12=wall_area_2,
    Data13=vertex_number_2,
    Data14=vertex_complexity_2,
    Data15=eri,
    Data16=convex_ratio,
    Data17=ri,
    Data18=density_4,
    Data19=no_of_voids_1,
    Data20=void_area_2,
    Data21=bboxarea_area,
    Data22=per_area,
    Data23=void_area_standard_deviation,
    Data24=point_on_bbox,
    Data25=no_of_intrusions_1,
    Data26=segments_std,
    Data27=segments_av)  # disabled
panel_204 = Panel(merge_15)  # disabled
flip_2 = FlipMatrix(Data=merge_15)  # disabled
